# Grasshopper definition My UI 2.gh (Grasshopper 1.0.7)
# plug-ins: Human UI, MyUI

# ---- group: Parameter Label
panel = Panel("------------------------------------Parameters--------------------------------------")
textsize = Slider(13, range=0..1000)
height = Slider(35, range=0..1000)
width = Slider(600, range=0..1000)
label = CreateLabel(LabelText=panel, LabelSize=textsize, Justification=0)
adjustpos = AdjustElementPositioning(ElementsToAdjust=label, Margin="50,10,5,10", AbsolutePositioning=False, Width=width, Height=height)

# ---- group: File Input
filepicker = CreateFilePicker(ButtonLabelText="Load Model(.3dm)", DialogType=Slider(0, range=0..100), MustExist=Toggle(True), Filter="All Files|*.*")
values = ValueListener(Elements=filepicker, SomeProperty=True)  # -> Values, Indices
adjustpos_2 = AdjustElementPositioning(ElementsToAdjust=filepicker, AbsolutePositioning=False, Height=Slider(37, range=0..100))
_3dm = Import3DM(File=values.Values, Layer="*", Name="*")

# ---- group: Input Label
panel_2 = Panel("------------------------------------Output--------------------------------------")
textsize_2 = Slider(13, range=0..1000)
height_2 = Slider(35, range=0..1000)
width_2 = Slider(600, range=0..1000)
label_2 = CreateLabel(LabelText=panel_2, LabelSize=textsize_2, Justification=0)
adjustpos_3 = AdjustElementPositioning(ElementsToAdjust=label_2, Margin="60,10,5,10", AbsolutePositioning=False, Width=width_2, Height=height_2)

# ---- group: Main Window
launchwin = LaunchWindow(
    Show=Toggle(True),
    Name="3D Model Interaction Tool",
    Width=Slider(600, range=0..1000),
    Height=Slider(600, range=0..1000),
    ChildStatus=0,
    EnableHorizScroll=False)

# ---- group: Input Label
panel_3 = Panel("------------------------------------Input--------------------------------------")
textsize_3 = Slider(13, range=0..1000)
height_3 = Slider(35, range=0..1000)
width_3 = Slider(600, range=0..1000)
label_3 = CreateLabel(LabelText=panel_3, LabelSize=textsize_3, Justification=0)
adjustpos_4 = AdjustElementPositioning(ElementsToAdjust=label_3, Margin="60,10,5,10", AbsolutePositioning=False, Width=width_3, Height=height_3)

# ---- group: Type
panel_4 = Panel("""quick touch
Hold
Press""")
pulldown = CreatePulldownMenu(Label="Type:", ListItems=panel_4, showLabel=True)
setlist = SetListContents(ListToModify=panel_4)

panel_5 = Panel("""Speaker
LED Light
Vibration
Rotational Motion
Translational Motion""")
pulldown_2 = CreatePulldownMenu(Label="Output parameter", ListItems=panel_5, showLabel=True)
setlist_2 = SetListContents(ListToModify=panel_5)

# ---- group: Input Parameter Selection
panel_6 = Panel("""Touch
Button
Light Sensor
Voice
Bluetooth Control""")
pulldown_3 = CreatePulldownMenu(Label="Input parameter:", ListItems=panel_6, showLabel=True)
setlist_3 = SetListContents(ListToModify=panel_6)

# ---- group: Parameter Selection
pulldown_4 = CreatePulldownMenu(Label="Select Parameters:", ListItems="Create New Parameter", showLabel=True)
setlist_4 = SetListContents(ListToModify="Create New Parameter")

# ----
true_button = CreateTrueOnlyButton(ButtonName="Set Area on Rhino", ButtonStyle=0)
label_4 = CreateLabel(LabelText="Target Area: ", LabelSize=12, Justification=0)
adjustpos_5 = AdjustElementPositioning(ElementsToAdjust=true_button, Margin="-250,0,0,-30", AbsolutePositioning=False)

brighness = Slider(10, range=0..10)
slider = CreateSlider(Slider=brighness, ShowBounds=False, ShowTicks=False, ShowTooltip=False, ShowValLabel=True, showLabel=True)
adjustpos_6 = AdjustElementPositioning(ElementsToAdjust=slider, Margin="0,30,0,0", AbsolutePositioning=False)

panel_7 = Panel("""Flash
Soft""")
pulldown_5 = CreatePulldownMenu(Label="Light Mode:", ListItems=panel_7, showLabel=True)
adjustpos_7 = AdjustElementPositioning(ElementsToAdjust=pulldown_5, Margin="-1,7,0,0", AbsolutePositioning=False)

button = CreateButton(ButtonName="Finish Selection", ButtonStyle=0)
true_button_2 = CreateTrueOnlyButton(ButtonName="Done", ButtonStyle=0)
values_2 = ValueListener(Elements=true_button, SomeProperty=True)  # -> Values, Indices
hideshow = HideShowElement(ElementToHideShow=button, Show=True, Collapse=True, Disable=Toggle(True))
values_3 = ValueListener(Elements=button, SomeProperty=True)  # -> Values, Indices
values_4 = ValueListener(Elements=pulldown_2, SomeProperty=True)  # -> Values, Indices
values_5 = ValueListener(Elements=pulldown, SomeProperty=True)  # -> Values, Indices
values_6 = ValueListener(Elements=pulldown_3, SomeProperty=True)  # -> Values, Indices
values_7 = ValueListener(Elements=pulldown_4, SomeProperty=True)  # -> Values, Indices
params_list = ListOfParameter(Param_name=values_7.Values, Input_param=values_6.Values, Input_type=values_5.Values, Output_param=values_4.Values)
area = SelectArea(Button=values_2.Values)  # -> Geometry_with_part, FinishSelection, TheModelBrep
route = Auto_route(CustomizedPart=area.Geometry_with_part, BasePartCenter=area.FinishSelection, TheModelBrep=area.TheModelBrep)
tb = CreateTextBlock(Text=route, TextSize=12, Justification=0)
merge = Merge(Data1=true_button, Data2=label_4, Data3=slider, Data4=pulldown_5, Data5=tb, Data6=true_button_2)

# ---- group: Modify button
panel_8 = Panel("Modify")
adjustpos_8 = AdjustElementPositioning(AbsolutePositioning=False, Width=Slider(100, range=0..100), Height=Slider(50, range=0..100))

# ----
true_button_3 = CreateTrueOnlyButton(ButtonName=panel_8, ButtonStyle=0)

# ---- group: Modify button (continued)
adjustelem = AdjustElementAppearance(ElementsToAdjust=true_button_3, FontSize=Slider(14, range=0..100))

# ----
values_8 = ValueListener(Elements=true_button_3, SomeProperty=True)  # -> Values, Indices

# ---- group: Main Window
launchwin_2 = LaunchWindow(
    Show=values_8.Values,
    Name="3D Model Interaction Tool",
    Width=Slider(600, range=0..1000),
    Height=Slider(600, range=0..1000),
    ChildStatus=0,
    EnableHorizScroll=False)

# ---- group: Elements that added to the Main Window
merge_2 = Merge(
    Data1=filepicker,
    Data2=flatten(_3dm),
    Data3=label,
    Data4=pulldown_4,
    Data5=label_3,
    Data6=pulldown_3,
    Data7=pulldown,
    Data8=label_2,
    Data9=pulldown_2,
    Data10=true_button_3)
addelems = AddElements(Window=launchwin, Elements=flatten(merge_2), DoVLChecking=True)  # -> AddedElements, ElementNames

# ----
childwin = MakeChildWindow(ParentWindow=launchwin, ChildWindow=launchwin_2)

# ---- group: Elements that added to the Main Window
addelems_2 = AddElements(Window=launchwin_2, Elements=flatten(merge), DoVLChecking=True)  # -> AddedElements, ElementNames
